# Grasshopper definition test_frog.gh (Grasshopper 1.0.7)
# Copyright: AMDlab
# plug-ins: FrOG

genes = GenePool(Decimals=2, Maximum=1, Minimum=0, Value=[1, 1, 1])
graph = GraphMapper(
    genes,
    x0=0,
    x1=1,
    y0=0,
    y1=1,
    Ox=0.2514489293,
    Oy=0.003261387348,
    Px=0.8673909307,
    Py=0.3728263974,
    container_name="Parabola")
graph_2 = GraphMapper(
    genes,
    x0=0,
    x1=1,
    y0=0,
    y1=1,
    A=-1.145949972,
    B=1.001044801,
    container_name="Linear",
    Graph_x0=0.2206518203,
    Graph_x1=0.8735501766,
    Graph_y0=0.7481888533,
    Graph_y1=0)
graph_3 = GraphMapper(genes, x0=0, x1=1, y0=0, y1=1, container_name="Gaussian", factor=0.253986299, mean=0.5532604456, sdev=0.3510867953)
merge = Merge(Data1=graph, Data2=graph_2, Data3=graph_3)
ma = MassAddition(Input=merge)  # -> Result, PartialResults
framework_for_optimization_in_grasshoppe = FrOG01(Variables=genes, Objective=ma.Result)  # "Framework for Optimization in Grasshopper"
